# Dynamo graph PAR_NL-SfB_family.dyn (Dynamo 2.12.0.5650)
# packages: Data-Shapes 2019.2.42, Orchid 230.0.2.7458, DYN_SharedParamTesting 1.0.0

# group: Set correct shared parameterfile and add ClassificationCode(4)
# note: Custom Node: Orchid v. 230.0.2.7458
current = Orchid.RevitProject.Common.Document.Current()
classificationCode = StringInput("ClassificationCode(4)")  # graph input
code_block = CodeBlock { "IFC Properties"; "Text"; "PG_IDENTITY_DATA"; }
boolean = BoolSelector(true)
addSharedParamsToFamily = RBG_VSNodes.Document.AddSharedParamsToFamily(SPParameterName=classificationCode, SPGroupName=code_block.out0, BuiltInPG=code_block.out1, IsInstance=boolean)

# group: NL/SfB tabel 1
# note: https://stprodeuwmystabu002stor.blob.core.windows.net/overig/NL-SfB_Tabel_0-4_Update-V201912.xlsx
file_path_to_nl_sfb_building = Filename("..\..\REVIT\NL-SfB_Tabel_0-4_Update-V201912.xlsx")  # "File Path to: NL/SfB building code"; graph input
# note: Custom Node: Data-Shapes v.2019.2.42
worksheets = Custom[Excel.Worksheets](FilePath=file_path_to_nl_sfb_building)  # package Data-Shapes; Gets worksheet names from specified Excel workbook.
code_block_2 = CodeBlock { 2; }
getItemAtIndex = List.GetItemAtIndex(list=worksheets, index=code_block_2)

# group: Import Excel
file_from_path = FileObject(path=file_path_to_nl_sfb_building)
boolean_2 = BoolSelector(false)
importExcel = Data.ImportExcel(file=file_from_path, sheetName=getItemAtIndex, readAsStrings=boolean_2, showExcel=boolean_2)
transpose = List.Transpose(lists=importExcel)
code_block_3 = CodeBlock()
# ---------- code_block_3.designscript (3 lines) ----------
//column E (the code)
//kolom F (the description)
4..5;
# ----------------------------------------
getItemAtIndex_2 = List.GetItemAtIndex(list=transpose, index=code_block_3)
string_from_object = FromObject(obj=getItemAtIndex_2)

# group: (change if your buildingcode is somewhere else in your familyname)
string_from_object_2 = FromObject(obj=current)
code_block_4 = CodeBlock { 18; 2; }
substring = String.Substring(string=string_from_object_2, startIndex=code_block_4.out0, length=code_block_4.out1)

# group: Filter buildingcodes based on Familyname
code_block_5 = CodeBlock { ":"; }
startsWith = String.StartsWith(string=string_from_object, searchFor=substring)
code_block_6 = CodeBlock { 0; }
getItemAtIndex_3 = List.GetItemAtIndex(list=startsWith, index=code_block_6)
filterByBoolMask = List.FilterByBoolMask(list=string_from_object@L2, mask=getItemAtIndex_3)
transpose_2 = List.Transpose(lists=filterByBoolMask.in)
join = String.Join(separator=code_block_5, string0=transpose_2)

# group: Hide part of the filtered texts you never need.
hide_constructief = BoolSelector(true)  # graph input
string = StringInput("; constructief")
contains = String.Contains(string=join, searchFor=string)
filterByBoolMask_2 = List.FilterByBoolMask(list=join, mask=contains)
if_ = RefactoredIf(test=hide_constructief, true=filterByBoolMask_2.out, false=join)

# group: Choose Classification
string_2 = StringInput("Choose Classification")
file_path = Filename(".\AG_DYN_logo.jpg")
code_block_7 = CodeBlock { "Classy!"; }
flatten = List.Flatten(list=if_)
firstItem = List.FirstItem(list=flatten)
# note: Custom Node: Data-Shapes v.2019.2.42
ui_radiobuttons_data = Custom[UI.RadioButtons Data](InputName=firstItem, Keys=flatten, Values=flatten)  # package Data-Shapes; Create radio buttons input for UI.MultipleInputForm ++ .
boolean_3 = BoolSelector(true)
# note: Maxheight is needed when you create a list with a lot of inputs. The inputs will run off the bottom of the screen. When setting a MAxheight you get a scroll-bar instead.
code_block_8 = CodeBlock { 750; 700; }
ui_multipleinputform = Custom[UI.MultipleInputForm ++](Description_optional=string_2, Logo_optional=file_path, ButtonText_optional=code_block_7, Inputs=ui_radiobuttons_data, Toggle=boolean_3, MaxHeight_optional=code_block_8.out0, Width_optional=code_block_8.out1)  # package Data-Shapes; Create a form with multiple inputs. see www.data-shapes.net for tutorials and infos!

# group: create name and set it to the formula
string_3 = StringInput("\"")
code_block_9 = CodeBlock(choice=ui_multipleinputform.User_Inputs) { "[NL-SfB tabel 1]"+choice; }
code_block_10 = CodeBlock(apostrophe=string_3, text=code_block_9) { apostrophe+text+apostrophe; }
# note: Custom Node: Orchid v. 230.0.2.7458
set = Orchid.RevitFamily.Formula.Set(familyDocument=current, parameterName=classificationCode, value=code_block_10)

# group: Wipe Ass
# note: Custom Node: Orchid v. 230.0.2.7458
all = Orchid.RevitFamily.FamilyType.All()
code_block_11 = CodeBlock { "Assembly Code"; ""; }
setValue = Orchid.RevitFamily.Parameter.SetValue(familyDocument=current, familyType=all, parameterName=code_block_11.out0, value=code_block_11.out1)

# group: Set IFC shared instance parameterfile
file_path_to_ifc_shared = Filename("..\..\REVIT\IFC Shared Parameters-RevitIFCBuiltIn_ALL.txt")  # "File Path to: IFC Shared Parameters-RevitIFCBuiltIn_ALL.txt"; graph input
# note: Custom Node: Orchid v. 230.0.2.7458
setFile = Orchid.RevitProject.Parameters.SharedParameter.SetFile(file=file_path_to_ifc_shared)
